# Grasshopper definition art_803_revised.gh (Grasshopper 1.0.7)
# plug-ins: Human

# (Input)
# Site_Curve
site_curve = Curve(<curve referenced from the Rhino model>)

# ---- group: Site Information
# Site Information
site_info = GhPythonScript(Site_Boundary=site_curve, Rot_Angle=Slider(0, range=0..360))  # -> out, Site_Boundary, Site_Area, Perimeter, Centre, Site_Vertices, Edges, Surface; inputs Site_Boundary: Curve
# ---------- site_info: Python ----------
__author__ = "DARSHAN.H.CHAVAN.H"
__version__ = "2022.05.15"

'''     Importing library       '''

import rhinoscriptsyntax as rs

'''     check IF its a closed curve     '''

def checkcurve(Site_Boundary):

    #If input is not curve
    if not rs.IsCurve(Site_Boundary):
        print("Error !!! Input needs to be closed curve")
    #If curve is not Closed curve
    if not rs.IsCurveClosed(Site_Boundary):
        print("ERROR !!! Input curve needs to be closed")
        
    else:
        #If it is a closecurve
        pass

#Calling function "checkcurve"
checkcurve(Site_Boundary)

'''      Function General information       '''

#Rotation
Rot_site_Crv = rs.RotateObject(Site_Boundary, rs.CurveAreaCentroid(Site_Boundary)[0], Rot_Angle)


def General_Info(Rot_site_Crv):
    
    #centre
    centre = rs.CurveAreaCentroid(Rot_site_Crv)
    
    #site Area
    Site_area = rs.CurveArea(Rot_site_Crv)
    
    #Perimeter
    Perimeter = rs.CurveLength(Rot_site_Crv)
    
    #vertex count
    vertex_count = rs.CurvePoints(Rot_site_Crv)
    
    #Edges
    Edges = rs.ExplodeCurves(Rot_site_Crv)
    
    #Site surface
    Surface = rs.AddPlanarSrf(Edges)
    
    return Rot_site_Crv, Site_area[0], Perimeter, centre[0], vertex_count, Edges, Surface


'''         OUTPUT          '''

Site_Boundary = Rot_site_Crv
Site_Area = "Site Area = " + str(General_Info(Site_Boundary)[1])
Perimeter = "Perimeter = " + str(General_Info(Site_Boundary)[2])
Centre = General_Info(Site_Boundary)[3]
Site_Vertices = General_Info(Site_Boundary)[4]
Edges = General_Info(Site_Boundary)[5] 
Surface = General_Info(Site_Boundary)[6]
# ---------- end site_info ----------

# ----
crv = Curve(site_info.Site_Boundary)
pt = Point(site_info.Site_Vertices)
crv_2 = Curve(site_info.Edges)
srf = Surface(site_info.Surface)
panel = Panel([site_info.Perimeter, site_info.Site_Area, site_info.Centre])
site_curve_2 = Curve(site_info.Site_Boundary)

# ---- group: Site Offset
# Site Offset
python = GhPythonScript(Site_Boundary=site_curve_2, offset_distance=Slider(6, range=0..20))  # -> out, Site_Boundary, Offset_Boundary, OffsetSrf, InteriorSrf, Area; inputs Site_Boundary: Curve
# ---------- python: Python ----------
__author__ = "DARSHAN.H.CHAVAN.H"
__version__ = "2022.05.15"

'''     Importing library       '''

import rhinoscriptsyntax as rs
import Rhino.Geometry as rg
import scriptcontext as sc

'''     check IF its a closed curve     '''

def checkcurve(Site_Boundary):
    #If input is curve
    if not rs.IsCurve(Site_Boundary):
        print("Error !!! Input needs to be closed curve")
    #If curve is not Closed curve
    if not rs.IsCurveClosed(Site_Boundary):
        print("ERROR !!! Input curve needs to be closed")
        
    else:
        #If it is a closecurve 
        pass

#Calling function "checkcurve"
checkcurve(Site_Boundary)

'''      Function Offset       '''

def Offset(Site_Boundary, offset_distance):
    
    #Centre of the curve
    centreCC = rs.CurveAreaCentroid(Site_Boundary)
    
    #Getting vertex of the site
    vertex = rs.CurvePoints(Site_Boundary)
    
    #Converting centre 3dpoint to GUID
    Guidpoint = sc.doc.Objects.AddPoint(centreCC[0])
    
    #Creating line to from centre to site vertex
    line = rs.AddLine(vertex[0], Guidpoint)
    
    #Length og the line
    length = rs.CurveLength(line)
    
    #Setting max limit of offset
    maxlimit = length / 5
    
    #Setting the minimum and maximum offset parameter
    if offset_distance >= 4 and offset_distance <= maxlimit:
        offsetcrv = rs.OffsetCurve(Site_Boundary, centreCC[0], float(offset_distance))
    else:
        # Error message for user
        offsetcrv = "Offset limit cannot be less than 4 M"
    #Return
    return offsetcrv

#Calling function offset
offsetcrv = Offset(Site_Boundary, offset_distance)

'''      Function for Surface       '''

def offsetSrf(Site_Boundary, offsetcrv):
    #Apending curves to empty list
    curves = []
    curves.append(Site_Boundary)
    curves.append(offsetcrv)
    # Surface from curves
    offsetsurface = rs.AddPlanarSrf(curves)
    
    #Return
    return offsetsurface

#Calling def offsetSrf
offsetSrf = offsetSrf(Site_Boundary, offsetcrv)

#Interior surface
InteriorSrf = rs.AddPlanarSrf(offsetcrv)

'''      Function to append Area of the two seperate Closedcurve       '''

def Area(offsetSrf, InteriorSrf):
    #Area 
    OffsetArea = rs.SurfaceArea(offsetSrf)
    IntArea = rs.SurfaceArea(InteriorSrf)
    
    #List to append both curve areas
    Area = []
    Area.append("Offset Area: " + str(OffsetArea[0]))
    Area.append("Interior Area: " + str(IntArea[0]))
    
    #Return
    return Area

'''     OUTPUT      '''

Site_Boundary = Site_Boundary
Offset_Boundary = offsetcrv
OffsetSrf = offsetSrf[0]
InteriorSrf = InteriorSrf[0]
Area = Area(offsetSrf, InteriorSrf)
# ---------- end python ----------

# ----
crv_3 = Curve(python.Site_Boundary)
crv_4 = Curve(python.Offset_Boundary)
srf_2 = Surface(python.OffsetSrf)
srf_3 = Surface(python.InteriorSrf)
panel_2 = Panel(python.Area)
offset_site_crv = Curve(python.Site_Boundary)
site_curve_3 = Curve(crv_3)
# Site Developer
# (Input)
# Divider_Curve
crv_5 = Curve([<curve referenced from the Rhino model> x2])

# ---- group: Site Developer
python_2 = GhPythonScript(
    Site_Boundary=site_curve_3,
    Offset_Boundary=offset_site_crv,
    Site_Divider=crv_5,
    Road_offset=Slider(5, range=2..8),
    Path_offset=Slider(1.5, range=0..3),
    ToggleFillet=Toggle(True),
    Road_Fillet=Slider(1.6, range=1..2.6),
    Path_Fillet=Slider(1.9, range=1..2.6),
    Parcel_Ht=Slider(0.2, range=0..2),
    Road_Ht=Slider(0.14, range=0..2),
    Pavement_Ht=Slider(0.44, range=0..2),
    Area_bound=Slider(3349.42, range=0..10000))  # -> out, ParcelCurve, ParcelSrf, ParcelSoild, port, RoadCrv, Road_Srf, RoadSolid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; inputs Site_Boundary: Curve, Offset_Boundary: Curve, Site_Divider: list of Curve
# ---------- python_2: Python ----------
__author__ = "DARSHAN.H.CHAVAN.H"
__version__ = "2022.05.16"

'''       Importing libraries    '''  

import rhinoscriptsyntax as rs
import ghpythonlib.treehelpers as th
import Rhino.Geometry as rg
import scriptcontext as sc
import random as rd
import ghpythonlib.components as ghc #used only thrice in this script

'''     Division of Site        '''

def DivisionOfSite(Site_Divider, Offset_Boundary):
    # Converting Guid to Rhino Geometry( Dividing Curves)
    RG_Site_Divider = []
    for i in Site_Divider:
        RG_Site_Divider.append(rs.coercecurve(i))

    # Converting Guid to Rhino Geometry( Boundary Site Curves)
    RG_Offset_Boundary = rs.coercecurve(Offset_Boundary)

    # Spliting site boundary using Grasshopper component in Python
    RGParcels = ghc.SurfaceSplit(RG_Offset_Boundary, RG_Site_Divider)

    # Converting Rhino geo Brep to GUID
    Parcel = []
    for i in RGParcels:
        Parcel.append(sc.doc.Objects.AddBrep(i))

    # Extracting edges from Surfaces
    Parcels = []
    for i in Parcel:
        Parcels.append(rs.DuplicateSurfaceBorder(i))

    #Return
    return Parcels

#Calling function DivisionOfSite
Parcels = DivisionOfSite(Site_Divider, Offset_Boundary)

'''     Centre of the Parcels       '''

#Centre of every curve
centre = []
for i in Parcels:
    centre.append(rs.CurveAreaCentroid(i))

'''     Offset for Road     '''

def OffsetRoad(Parcels, centre, Road_offset):
    
    #Dividing by 2 to make easier for user
    #Explaination : If Input from user is 4, 8m wide road is created(fillet on both curves)
    #To avoid it it is divided by 2.

    Offparam = Road_offset/2

    #Setting restriction for offset value
    if Offparam >= 2 and Offparam <= 4:
        #Iterating and appending the offset curve to empty list
        OffsetRd = []
        for i, j in zip (Parcels, centre):
            OffsetRd.append(rs.OffsetCurve(i, j[0], Offparam))

    else:
        #Error message to user guidance
        OffsetRd = ("ERROR!!! Road width cannot exceed 8M")

    #Return curves
    return OffsetRd

#Calling function Offset
OffsetRd = OffsetRoad(Parcels, centre, Road_offset)

'''     Offset for Path     '''

def OffsetPath(Path_offset,OffsetRd):
    #Setting restriction for offset value
    if Path_offset >= 1.5 and Path_offset <= 2.5:
        #Centre of every curve and appending to empty list
        OffsetRdCentre = []
        for i in OffsetRd:
            OffsetRdCentre.append(rs.CurveAreaCentroid(i))

        #Iterating and appending the offset curve to empty list
        PathCrv = []
        for i, j in zip(OffsetRd, OffsetRdCentre):
            PathCrv.append(rs.OffsetCurve(i, j[0], Path_offset))

    else:
        #Error message to user guidance
        PathCrv = ("ERROR!!! Pathway width cannot be less than 1M and more than 2.5M")

    #Return curves
    return PathCrv

# Calling function OffsetPath
PathCrv = OffsetPath(Path_offset,OffsetRd)

'''        Fillet Function     '''

def Fillet(OffsetRd, PathCrv, Road_Fillet, Path_Fillet):
    # Toggle for fillet option(Toggle: 0n)
    if ToggleFillet:
        # Iterating road and path curves to fillet it and storing in empty list respectively
        _Road = []
        _Path = []
        for i,j in zip(OffsetRd, PathCrv):
            _Road.append(rg.Curve.CreateFilletCornersCurve(
                rs.coercecurve(i), float(Road_Fillet), 0.001, 0.001))
            _Path.append(rg.Curve.CreateFilletCornersCurve(
            rs.coercecurve(j), float(Path_Fillet), 0.001, 0.001))

    #(Toggle: 0ff)
    else:
        # Storing road and path curves without filleting
        _Road = OffsetRd
        _Path = PathCrv

    # Return of road and path curves
    return _Road, _Path

# Calling function Fillet
_Road = Fillet(OffsetRd, PathCrv, Road_Fillet, Path_Fillet)[0]
_Path = Fillet(OffsetRd, PathCrv, Road_Fillet, Path_Fillet)[1]


'''     Road and Path curves      '''

def RoadandPathCurves(_Road, _Path):

    #Creating only Path curves to further make surface
    PathCrv = []
    for r,p in zip(_Road, _Path):
        PathCrv.append(rs.CurveBooleanDifference(r, p, 0.001))
    
    # Creating only Road curves to further make surface
    RoadCrv = []
    # Appending Site curve to an empty list
    RoadCrv.append(Site_Boundary)
    #Iterating list if curves(path innercrv = parcels boundary) and appending to an empty list
    for i in _Road:
        RoadCrv.append(i)

    # Return 
    return RoadCrv, PathCrv

# Calling function RoadandPathCurves
RoadCrv = RoadandPathCurves(_Road, _Path)[0]
PathCrv = RoadandPathCurves(_Road, _Path)[1]

'''     Surface     '''

#Roaf Surface
def Surfaces(RoadCrv, PathCrv, _Path, ToggleFillet):

    #Toggle Fillet On
    if ToggleFillet:
        # Road surface using grasshopper component in python(with Fillet)
        Road_Srf = ghc.BoundarySurfaces(RoadCrv)

    #Toggle Fillet Off
    else:
        # Convertnig Guid to Rhino Geometry
        curvePath = []
        for i in _Road:
            curvePath.append(rs.coercecurve(i))

        # Appending site boundary and set of path curves in an empty list
        NEWlist = []
        NEWlist.append(Site_Boundary)
        for i in curvePath:
            NEWlist.append(i)
        # Road surface using grasshopper component in python(without fillet)
        Road_Srf = ghc.BoundarySurfaces(NEWlist)

    # Path surface from curves  #
    PathSrf = []
    for i in PathCrv:
        PathSrf.append(rs.AddPlanarSrf(i))

    #Parcel Surface

    #Toggle Fillet On
    if ToggleFillet:
        #Re-adding curve to convert into GUID
        p = []
        for i in _Path:
            p.append(sc.doc.Objects.AddCurve(i))
        #Parcel surface from curves(with Fillet)
        ParcelSrf = []
        for i in p:
            ParcelSrf.append(rs.AddPlanarSrf(i))

    #Toggle Fillet Off
    else:
        # Parcel surface from curves(without Fillet)
        ParcelSrf = []
        for i in _Path:
            ParcelSrf.append(rs.AddPlanarSrf(i))

    #Return
    return Road_Srf, PathSrf, ParcelSrf

# Calling individual items using index no. based on return value of the function 
Road_Srf = Surfaces(RoadCrv, PathCrv, _Path, ToggleFillet)[0]
PathSrf = Surfaces(RoadCrv, PathCrv, _Path, ToggleFillet)[1]
ParcelSrf = Surfaces(RoadCrv, PathCrv, _Path, ToggleFillet)[2]

'''     Solids     '''

# Height(Ht) is a parameter for the user.
# Function Solid
def Solid(ParcelSrf, Road_Srf, PathSrf, Parcel_Ht, Road_Ht, Pavement_Ht):

    # Parcel Soild
    ParcelSoild = []
    for i in ParcelSrf:
        ParcelSoild.append(rs.ExtrudeSurface(i, (rs.AddLine((0,0,0), (0,0,Parcel_Ht))), True))

    # Re-adding curve to convert into GUID
    GuidRoad = sc.doc.Objects.AddBrep(Road_Srf)

    # Road Solid
    RoadSolid = rs.ExtrudeSurface(GuidRoad, (rs.AddLine((0,0,0), (0,0,Road_Ht))), True)

    # Path Solid
    PathSoild = []
    for i in PathSrf:
        PathSoild.append(rs.ExtrudeSurface(i, (rs.AddLine((0,0,0), (0,0,Pavement_Ht))), True))

    #Return
    return ParcelSoild, RoadSolid, PathSoild

# Calling individual items using index no. based on return value of the function
ParcelSoild = Solid(ParcelSrf, Road_Srf, PathSrf, Parcel_Ht, Road_Ht, Pavement_Ht)[0]
RoadSolid = Solid(ParcelSrf, Road_Srf, PathSrf, Parcel_Ht, Road_Ht, Pavement_Ht)[1]
PathSoild = Solid(ParcelSrf, Road_Srf, PathSrf, Parcel_Ht, Road_Ht, Pavement_Ht)[2]

'''     Sorting of parcels with area bound     '''

def Sort_by_Area(_Path, Area_bound):
    #Toggle Fillet on
    if ToggleFillet:
        #Area of the parcels
        Area = []
        for i in _Path:
            Area.append(rs.Area(sc.doc.Objects.AddCurve(i)))
        
        #Empty list to append sorted curves
        Small_space = []
        Sorted_block = []
        #Accessing each curve using for loop
        for i in _Path:
            # if condition to seperate curves by area
            if rs.Area(sc.doc.Objects.AddCurve(i))<= Area_bound:
                Small_space.append(sc.doc.Objects.AddCurve(i))
            else:
                Sorted_block.append(sc.doc.Objects.AddCurve(i))
    #Toggle Fillet off
    else:
        Area = []
        for i in _Path:
            Area.append(rs.Area(i))
        
        #Empty list to append sorted curves
        Small_space = []
        Sorted_block = []
        #Accessing each curve using for loop
        for i in _Path:
            # if condition to seperate curves by area
            if rs.Area(i)<= Area_bound:
                Small_space.append(i)
            else:
                Sorted_block.append(i)
    #Return
    return Small_space, Sorted_block

# Calling individual items using index no. based on return value of the function
Small_space = Sort_by_Area(_Path, Area_bound)[0]
Sorted_block = Sort_by_Area(_Path, Area_bound)[1]
def trees(Small_space):
    #Create surface of small space
    Park_Srf = []
    for i in Small_space:
        Park_Srf.append(rs.AddPlanarSrf(i))
    #Randompoints for no. of trees
    RandomPts = []
    i = 1
    while i <= len(Park_Srf):
        RandomPts.append(rd.randint(3,5))
        i +=1
    #Populating points of surface
    PopPts = []
    for i,j in zip(Park_Srf, RandomPts):
        PopPts.append(ghc.PopulateGeometry([rs.coercebrep(i)],[j],[2]))
    #flattening points
    allpoints = []
    for i in PopPts:
        for i in i:
            allpoints.append(i)
    #Creating random points for height 
    i = 1
    TreeHt = []
    while i <= len(allpoints):
        TreeHt.append(rd.randint(6,12))
        i += 1
    #Moving points upwards with random heights 
    TopPts = []
    for i,j in zip(allpoints, TreeHt):
        TopPts.append(rs.MoveObject((sc.doc.Objects.AddPoint(i)), (0,0,j)))
    #Creating sphere and line for tree
    TreeHead = []
    lines = []
    for i, j in zip(TopPts, allpoints):
        TreeHead.append(rs.AddSphere((rs.coerce3dpoint(i)),(rd.randint(3,5))))
        lines.append(rs.AddLine(i,j))
    #Making list of treehead and treeline in a list
    Trees = []
    for i,j in zip(TreeHead, lines):
        Trees.append([i,j])
    return Trees

#Calling function Trees
Trees = trees(Small_space)
'''     Output  Flatten    Curves       '''
#Flatten ParcelCurve
ParcelCurve = th.list_to_tree(_Path)
ParcelCurve.Flatten()

#Flatten RoadCrv
RoadCrv = th.list_to_tree(RoadCrv)
RoadCrv.Flatten()

#Flatten PathCrv
PathCrv = th.list_to_tree(PathCrv)
PathCrv.Flatten()

'''     Output  Flatten    Surface       '''
#Flatten ParcelSrf
ParcelSrf = th.list_to_tree(ParcelSrf)
ParcelSrf.Flatten()

#Flatten PathSrf
PathSrf = th.list_to_tree(PathSrf)
PathSrf.Flatten()

'''     Output  Flatten    Solid       '''
##Flatten PathSolid
PathSoild = th.list_to_tree(PathSoild)
PathSoild.Flatten()

#Flatten ParcelSoild
ParcelSoild = th.list_to_tree(ParcelSoild)
ParcelSoild.Flatten()

'''     Sort_by_Area      '''
#Flatten Small_Space
Small_space = th.list_to_tree(Small_space)
Small_space.Flatten()

#Flatten Small_Space
Sorted_block = th.list_to_tree(Sorted_block)
Sorted_block.Flatten()

#Flatten Small_Space
Trees = th.list_to_tree(Trees)
Trees.Flatten()

''' Reference   '''
# ---------- end python_2 ----------

# ----
curve = Merge(Data1=python_2.ParcelCurve, Data2=python_2.RoadCrv, Data3=python_2.PathCrv)
merge = Merge(Data1=python_2.ParcelSrf, Data2=python_2.Road_Srf, Data3=python_2.PathSrf)
merge_2 = Merge(Data1=python_2.ParcelSoild, Data2=python_2.RoadSolid, Data3=python_2.PathSoild)
crv_6 = Curve(python_2.Small_space)
crv_7 = Curve(python_2.Sorted_block)
relay = Relay()

# ----
# Substraction method
# setting reference
number_slider = Slider(6, range=0..10)
number_slider_2 = Slider(10, range=0..50)
number_slider_3 = Slider(60, range=1..500)
number_slider_4 = Slider(32, range=10..50)
# ParcelCurve
number_slider_5 = Slider(4, range=1..5)

crv_8 = Curve(crv_6)
crv_9 = Curve([<curve referenced from the Rhino model> x2])
number_slider_6 = Slider(6, range=5..10)  # disabled

toggle = BooleanToggle(False)
number_slider_7 = Slider(8, range=1..30)
number_slider_8 = Slider(6, range=5..30)

toggle_2 = BooleanToggle(False)
number_slider_9 = Slider(13, range=5..30)
number_slider_10 = Slider(1, range=0..10)

number_slider_11 = Slider(3, range=0..50)
number_slider_12 = Slider(6, range=0..10)

parcelcurve = Curve(crv_6)
python_3 = GhPythonScript(
    ParcelCurve=parcelcurve,
    Toggle_Podium=Toggle(True),
    PodiumHt=Slider(5, range=3..6),
    Bldg_Divider=crv_9,
    No_of_Pod_Floors=Slider(3, range=1..3),
    Podium_Boundary=Slider(5, range=1..5),
    Bldg_Boundary=Slider(1, range=1..20),
    Floor_Ht=Slider(9, range=3..15),
    No_of_Floors=Slider(5, range=1..20),
    No_of_Frames=Slider(10, range=10..20))  # -> out, Window, Building, GlassFrames, Info, podBuilding, podWindow, podGlassFrames, bldgbasecrv; inputs ParcelCurve: list of Curve, PodiumHt: Int32, Bldg_Divider: list of Curve, No_of_Pod_Floors: Int32, Podium_Boundary: Int32, Floor_Ht: Int32, No_of_Floors: Int32
# ---------- python_3: Python ----------
__author__ = "DARSHAN.H.CHAVAN.H"
__version__ = "2022.06.06"

import rhinoscriptsyntax as rs
import scriptcontext as sc
import ghpythonlib.treehelpers as th
import Rhino.Geometry as rg
import ghpythonlib.components as ghc
import random as rd
#Converting Rhino Geo to guid
GuidCrv = []
for i in ParcelCurve:
    GuidCrv.append(sc.doc.Objects.AddCurve(i))



if Toggle_Podium:
    print ( "Create Podium" )
        #Converting Rhino Geo to guid
    GuidCrv = []
    for i in ParcelCurve:
        GuidCrv.append(sc.doc.Objects.AddCurve(i))

    #Centre of the curve
    Centres = []
    for i in GuidCrv:
        Centres.append(rs.CurveAreaCentroid(i))

    #Offset of curve
    podiumCrv = []
    for i,j in zip(GuidCrv,Centres):
        podiumCrv.append(rs.OffsetCurve(i, j[0], Podium_Boundary))
    #move Ceiling Curve in Z direction and exploding base curve
    podCeilingCrv = []
    podExplode_Crv = []
    for i,j in zip(podiumCrv, Centres):
        podCeilingCrv.append(rs.CopyObject(i, [0,0,PodiumHt - 0.15]))
        podExplode_Crv.append(rs.ExplodeCurves(i))
    #Creating Podium slab
    def slab(podCeilingCrv):
        #Ceiling Surface
        podCeilSrf = []
        for i in podCeilingCrv:
            podCeilSrf.append(rs.AddPlanarSrf(i))
        #Slab Solid
        podslab = []
        for i in podCeilSrf:
            line = rs.AddLine((0,0,0), (0,0, 0.15))
            podslab.append(rs.ExtrudeSurface(i,line))
        return podslab

    #Calling slab function
    podslab = slab(podCeilingCrv)
    
    def createPodGlassandBldgFrame(podExplode_Crv):
        #extruding explode curve
        podsurfaces = []
        for list in podExplode_Crv:
            for i in list:
                podsurfaces.append(rs.ExtrudeCurve
                    (i, (rs.AddLine([0,0,0],[0,0,PodiumHt - 0.15]))))
        
        #Centre of the surface  <3dPoint>
        podcSrf =  []
        for i in podsurfaces:
            podcSrf.append(rs.SurfaceAreaCentroid(i))
        
        #Scaling it small for window puncture   <Surface>
        podGlass = []
        for i, j in zip(podsurfaces, podcSrf):
            podGlass.append(rs.ScaleObject(i,j[0], [ 0.9, 0.9, 0.9], True))
        
        #Making Solid of window to puncture <Solid>
        podsolidFrame = []
        for i in podGlass:
            podsolidFrame.append(rs.OffsetSurface(i, 0.5, 0.001, True, True))
        
        #Making Solid of window to puncture <Solid>
        podsolidFramenew = []
        for i in podsurfaces:
            podsolidFramenew.append(rs.OffsetSurface
                (i, 0.230, 0.001, False, True))
        
        podvoid = []
        for i, j in zip(podsolidFramenew, podsolidFrame):
            podvoid.append(rs.BooleanDifference(i,j,False))
        return podGlass, podvoid

    podGlass = createPodGlassandBldgFrame(podExplode_Crv)[0]
    podvoid = createPodGlassandBldgFrame(podExplode_Crv)[1]
    
    def createpodSolidPurlin(podGlass, No_of_Frames):
        #Extracting border curves from glass surface    <Curves>
        podglassFrame = []
        for i in podGlass:
            podglassFrame.append(rs.DuplicateSurfaceBorder(i))
        
        #Exploding curves   <Curve>
        podexpCurve = []
        for i in podglassFrame:
            podexpCurve.append(rs.ExplodeCurves(i))
        
        #Extracting top and botttom curve from the frame    <Curves>
        podtopCurve = []
        podbottomCurve = []
        for i in podexpCurve:
            podtopCurve.append(i[0])
            podbottomCurve.append(i[2])
        
        #Dividing the top and bottom curve  <3dPoint>
        podtopDivPnts = []
        podbottomDivPnts = []
        for i,j in zip(podtopCurve, podbottomCurve):
            podtopDivPnts.append(rs.DivideCurve(i, No_of_Frames, True, True))
            podbottomDivPnts.append(rs.DivideCurve(j, No_of_Frames, True, True))
        
        #Creating curves from top and bottom points  <curves>
        podpurlinCrv = []
        podtopCircle = []
        podbottomCircle = []
        for i,j in zip(podtopDivPnts, podbottomDivPnts):
            #List j is reversed to get straight lines
            for p,k in zip(i,j[::-1]):
                #Converting rhino point to Guid point using sc
                podpurlinCrv.append(rs.AddLine(sc.doc.Objects.AddPoint(p),sc.doc.Objects.AddPoint(k)))
                podtopCircle.append(rs.AddCircle(sc.doc.Objects.AddPoint(p), 0.05))
                podbottomCircle.append(rs.AddCircle(sc.doc.Objects.AddPoint(k), 0.05))
        
        #Solid purlin    <Solid>
        podsolidPurlin = []
        for i,j in zip(podtopCircle, podbottomCircle):
            podsolidPurlin.append(rs.AddLoftSrf([i,j]))
        return podsolidPurlin
        
    podsolidPurlin = createpodSolidPurlin(podGlass, No_of_Frames)
    
    def creatingPodFloors(podvoid, podGlass, podslab, podsolidPurlin, No_of_Pod_Floors):
        podBuilding = []
        podWindow = []
        for i, j in zip(podvoid, podGlass):
            for h in range(No_of_Pod_Floors):
                podBuilding.append(rs.CopyObject(i, (0,0,PodiumHt*h)))
                podWindow.append(rs.CopyObject(j, (0,0,PodiumHt*h)))
    
        #Copying slab and adding to the Building list
        for i in podslab:
            for h in range(No_of_Pod_Floors):
                podBuilding.append(rs.CopyObject(i, (0,0,PodiumHt*h)))
    
        #Copying frames and adding to the GlassFrames list
        podGlassFrames = []
        for i in podsolidPurlin:
            for h in range(No_of_Pod_Floors):
                podGlassFrames.append(rs.CopyObject(i, (0,0,PodiumHt*h)))
        return podBuilding, podWindow, podGlassFrames
        
    #Calling creatingFloors function
    podBuilding = creatingPodFloors(podvoid, podGlass, 
        podslab, podsolidPurlin, No_of_Pod_Floors)[0]
    podWindow = creatingPodFloors(podvoid, podGlass,
        podslab, podsolidPurlin, No_of_Pod_Floors)[1]
    podGlassFrames = creatingPodFloors(podvoid, podGlass,
        podslab, podsolidPurlin, No_of_Pod_Floors)[2]
        
    def creatingBldgBase(podiumCrv, Bldg_Divider):
        #Getting top curve of podium for building base
        bldgbasecrv = []
        for i in podiumCrv:
            bldgbasecrv.append(rs.CopyObject(i,[0,0,No_of_Pod_Floors*PodiumHt]))
            
        #dividing building base curve
        # Converting Guid to Rhino Geometry( Boundary Site Curves)
        rgBldgBasecrv = []
        for i in bldgbasecrv:
            rgBldgBasecrv.append(rs.coercecurve(i))
    
        # Spliting site boundary using Grasshopper component in Python
        bldgParcels = ghc.SurfaceSplit(rgBldgBasecrv, Bldg_Divider)
        
        # Converting Rhino geo Brep to GUID
        bldgGuid = []
        for i in bldgParcels:
            bldgGuid.append(sc.doc.Objects.AddBrep(i))
    
        # Extracting edges from Surfaces
        bldgAreaCrv = []
        for i in bldgGuid:
            bldgAreaCrv.append(rs.DuplicateSurfaceBorder(i))
    
        #Offset for creating buiding building base
        #Centre of the curve
        bldgCentres = []
        for i in bldgAreaCrv:
            bldgCentres.append(rs.CurveAreaCentroid(i))
            
        #Offset of curve
        bldgBaseCrv = []
        for i,j in zip(bldgAreaCrv,bldgCentres):
            bldgBaseCrv.append(rs.OffsetCurve(i, j[0], 5))
        return bldgBaseCrv
    
    bldgBaseCrv = creatingBldgBase(podiumCrv, Bldg_Divider)
#############################################################
    #move Ceiling Curve in Z direction and exploding base curve
    CeilingCrv = []
    Explode_Crv = []
    for i in bldgBaseCrv:
        CeilingCrv.append(rs.CopyObject(i, [0,0,Floor_Ht - 0.15]))
        Explode_Crv.append(rs.ExplodeCurves(i))
        
    def createGlassandBldgFrame(Explode_Crv):
        #extruding explode curve
        surfaces = []
        for list in Explode_Crv:
            for i in list:
                surfaces.append(rs.ExtrudeCurve(i, (rs.AddLine([0,0,0],[0,0,Floor_Ht - 0.15]))))
        
        #Centre of the surface  <3dPoint>
        cSrf =  []
        for i in surfaces:
            cSrf.append(rs.SurfaceAreaCentroid(i))
        
        #Scaling it small for window puncture   <Surface>
        Glass = []
        for i, j in zip(surfaces, cSrf):
            Glass.append(rs.ScaleObject(i,j[0], [ 0.9, 0.9, 0.9], True))
        
        #Making Solid of window to puncture <Solid>
        solidFrame = []
        for i in Glass:
            solidFrame.append(rs.OffsetSurface(i, 0.5, 0.001, True, True))
        
        #Making Solid of window to puncture <Solid>
        solidFramenew = []
        for i in surfaces:
            solidFramenew.append(rs.OffsetSurface(i, 0.230, 0.001, False, True))

        void = []
        for i, j in zip(solidFramenew, solidFrame):
            void.append(rs.BooleanDifference(i,j,False))
        return Glass, void

    Glass = createGlassandBldgFrame(Explode_Crv)[0]
    void = createGlassandBldgFrame(Explode_Crv)[1]

    def createSolidPurlin(Glass, No_of_Frames):
        #Extracting border curves from glass surface    <Curves>
        glassFrame = []
        for i in Glass:
            glassFrame.append(rs.DuplicateSurfaceBorder(i))
        
        #Exploding curves   <Curve>
        expCurve = []
        for i in glassFrame:
            expCurve.append(rs.ExplodeCurves(i))
        
        #Extracting top and botttom curve from the frame    <Curves>
        topCurve = []
        bottomCurve = []
        for i in expCurve:
            topCurve.append(i[3])
            bottomCurve.append(i[1])
        
        #Dividing the top and bottom curve  <3dPoint>
        topDivPnts = []
        bottomDivPnts = []
        for i,j in zip(topCurve, bottomCurve):
            topDivPnts.append(rs.DivideCurve(i, No_of_Frames, True, True))
            bottomDivPnts.append(rs.DivideCurve(j, No_of_Frames, True, True))
        
        #Creating curves from top and bottom points  <curves>
        purlinCrv = []
        topCircle = []
        bottomCircle = []
        for i,j in zip(topDivPnts, bottomDivPnts):
            #List j is reversed to get straight lines
            for p,k in zip(i,j[::-1]):
                #Converting rhino point to Guid point using sc
                purlinCrv.append(rs.AddLine(sc.doc.Objects.AddPoint(p),sc.doc.Objects.AddPoint(k)))
                topCircle.append(rs.AddCircle(sc.doc.Objects.AddPoint(p), 0.05))
                bottomCircle.append(rs.AddCircle(sc.doc.Objects.AddPoint(k), 0.05))
        
        #Solid purlin    <Solid>
        solidPurlin = []
        for i,j in zip(topCircle, bottomCircle):
            solidPurlin.append(rs.AddLoftSrf([i,j]))
        return solidPurlin
    
    solidPurlin = createSolidPurlin(Glass, No_of_Frames)
    
    def slab(CeilingCrv):
        #Ceiling Surface
        CeilSrf = []
        for i in CeilingCrv:
            CeilSrf.append(rs.AddPlanarSrf(i))
        
        #Slab Solid
        slab = []
        for i in CeilSrf:
            line = rs.AddLine((0,0,0), (0,0, 0.2))
            slab.append(rs.ExtrudeSurface(i,line))
        return slab
    
#    Calling slab function
    slab = slab(CeilingCrv)
    
    def creatingFloors(void, Glass, slab, solidPurlin, No_of_Floors):
        Building = []
        Window = []
        for i, j in zip(void, Glass):
            for h in range(No_of_Floors):
                Building.append(rs.CopyObject(i, (0,0,Floor_Ht*h)))
                Window.append(rs.CopyObject(j, (0,0,Floor_Ht*h)))
    
        #Copying slab and adding to the Building list
        for i in slab:
            for h in range(No_of_Floors):
                Building.append(rs.CopyObject(i, (0,0,Floor_Ht*h)))
    
        #Copying frames and adding to the GlassFrames list
        GlassFrames = []
        for i in solidPurlin:
            for h in range(No_of_Floors):
                GlassFrames.append(rs.CopyObject(i, (0,0,Floor_Ht*h)))
        return Building, Window, GlassFrames
    
    #Calling creatingFloors function
    Building = creatingFloors(void, Glass, slab, solidPurlin, No_of_Floors)[0]
    Window = creatingFloors(void, Glass, slab, solidPurlin, No_of_Floors)[1]
    GlassFrames = creatingFloors(void, Glass, slab, solidPurlin, No_of_Floors)[2]
    
    #Flatten bottomCurve
    podBuilding = th.list_to_tree(podBuilding)
    podBuilding.Flatten()
    
    podWindow = th.list_to_tree(podWindow)
    podWindow.Flatten()
    
    podGlassFrames = th.list_to_tree(podGlassFrames)
    podGlassFrames.Flatten()

else:

    def creatingBldgBase(GuidCrv, Bldg_Divider):
        #Centre of the curve
        Centres = []
        for i in GuidCrv:
            Centres.append(rs.CurveAreaCentroid(i))
            
        #Offset of curve
        bldgBaseCrv = []
        for i,j in zip(GuidCrv,Centres):
            bldgBaseCrv.append(rs.OffsetCurve(i, j[0], Bldg_Boundary))

        #dividing building base curve
        # Converting Guid to Rhino Geometry( Boundary Site Curves)
        rgBldgBaseCrv = []
        for i in bldgBaseCrv:
            rgBldgBaseCrv.append(rs.coercecurve(i))
    
        # Spliting site boundary using Grasshopper component in Python
        bldgParcels = ghc.SurfaceSplit(rgBldgBaseCrv, Bldg_Divider)
        
        # Converting Rhino geo Brep to GUID
        bldgGuid = []
        for i in bldgParcels:
            bldgGuid.append(sc.doc.Objects.AddBrep(i))
    
        # Extracting edges from Surfaces
        bldgAreaCrv = []
        for i in bldgGuid:
            bldgAreaCrv.append(rs.DuplicateSurfaceBorder(i))
    
        #Offset for creating buiding building base
        #Centre of the curve
        bldgCentres = []
        for i in bldgAreaCrv:
            bldgCentres.append(rs.CurveAreaCentroid(i))
            
        #Offset of curve
        bldgBaseCrv = []
        for i,j in zip(bldgAreaCrv,bldgCentres):
            bldgBaseCrv.append(rs.OffsetCurve(i, j[0], 5))
        return bldgBaseCrv
    
    bldgBaseCrv = creatingBldgBase(GuidCrv, Bldg_Divider)
    
    #move Ceiling Curve in Z direction and exploding base curve
    CeilingCrv = []
    Explode_Crv = []
    for i in bldgBaseCrv:
        CeilingCrv.append(rs.CopyObject(i, [0,0,Floor_Ht - 0.15]))
        Explode_Crv.append(rs.ExplodeCurves(i))
        
    def createGlassandBldgFrame(Explode_Crv):
        #extruding explode curve
        surfaces = []
        for list in Explode_Crv:
            for i in list:
                surfaces.append(rs.ExtrudeCurve(i, (rs.AddLine([0,0,0],[0,0,Floor_Ht - 0.15]))))
        
        #Centre of the surface  <3dPoint>
        cSrf =  []
        for i in surfaces:
            cSrf.append(rs.SurfaceAreaCentroid(i))
        
        #Scaling it small for window puncture   <Surface>
        Glass = []
        for i, j in zip(surfaces, cSrf):
            Glass.append(rs.ScaleObject(i,j[0], [ 0.9, 0.9, 0.9], True))
        
        #Making Solid of window to puncture <Solid>
        solidFrame = []
        for i in Glass:
            solidFrame.append(rs.OffsetSurface(i, 0.5, 0.001, True, True))
        
        #Making Solid of window to puncture <Solid>
        solidFramenew = []
        for i in surfaces:
            solidFramenew.append(rs.OffsetSurface(i, 0.230, 0.001, False, True))

        void = []
        for i, j in zip(solidFramenew, solidFrame):
            void.append(rs.BooleanDifference(i,j,False))
        return Glass, void

    Glass = createGlassandBldgFrame(Explode_Crv)[0]
    void = createGlassandBldgFrame(Explode_Crv)[1]

    def createSolidPurlin(Glass, No_of_Frames):
        #Extracting border curves from glass surface    <Curves>
        glassFrame = []
        for i in Glass:
            glassFrame.append(rs.DuplicateSurfaceBorder(i))
        
        #Exploding curves   <Curve>
        expCurve = []
        for i in glassFrame:
            expCurve.append(rs.ExplodeCurves(i))
        
        #Extracting top and botttom curve from the frame    <Curves>
        topCurve = []
        bottomCurve = []
        for i in expCurve:
            topCurve.append(i[3])
            bottomCurve.append(i[1])
        
        #Dividing the top and bottom curve  <3dPoint>
        topDivPnts = []
        bottomDivPnts = []
        for i,j in zip(topCurve, bottomCurve):
            topDivPnts.append(rs.DivideCurve(i, No_of_Frames, True, True))
            bottomDivPnts.append(rs.DivideCurve(j, No_of_Frames, True, True))
        
        #Creating curves from top and bottom points  <curves>
        purlinCrv = []
        topCircle = []
        bottomCircle = []
        for i,j in zip(topDivPnts, bottomDivPnts):
            #List j is reversed to get straight lines
            for p,k in zip(i,j[::-1]):
                #Converting rhino point to Guid point using sc
                purlinCrv.append(rs.AddLine(sc.doc.Objects.AddPoint(p),sc.doc.Objects.AddPoint(k)))
                topCircle.append(rs.AddCircle(sc.doc.Objects.AddPoint(p), 0.05))
                bottomCircle.append(rs.AddCircle(sc.doc.Objects.AddPoint(k), 0.05))
        
        #Solid purlin    <Solid>
        solidPurlin = []
        for i,j in zip(topCircle, bottomCircle):
            solidPurlin.append(rs.AddLoftSrf([i,j]))
        return solidPurlin
    
    solidPurlin = createSolidPurlin(Glass, No_of_Frames)
    
    def slab(CeilingCrv):
        #Ceiling Surface
        CeilSrf = []
        for i in CeilingCrv:
            CeilSrf.append(rs.AddPlanarSrf(i))
        
        #Slab Solid
        slab = []
        for i in CeilSrf:
            line = rs.AddLine((0,0,0), (0,0, 0.2))
            slab.append(rs.ExtrudeSurface(i,line))
        return slab
    
#    Calling slab function
    slab = slab(CeilingCrv)


    def creatingFloors(void, Glass, slab, solidPurlin, No_of_Floors):
        Building = []
        Window = []
        for i,j in zip(void, Glass):
            for h in range (No_of_Floors):
    
                    Building.append(rs.CopyObject(i, (0,0,Floor_Ht*h)))
                    Window.append(rs.CopyObject(j, (0,0,Floor_Ht*h)))
        
            #Copying slab and adding to the Building list
            for i in slab:
                for h in range(No_of_Floors):
                    Building.append(rs.CopyObject(i, (0,0,Floor_Ht*h)))
        
            #Copying frames and adding to the GlassFrames list
            GlassFrames = []
            for i in solidPurlin:
                for h in range(No_of_Floors):
                    GlassFrames.append(rs.CopyObject(i, (0,0,Floor_Ht*h)))
        return Building, Window, GlassFrames
    
    #Calling creatingFloors function
    Building = creatingFloors(void, Glass, slab, solidPurlin, No_of_Floors)[0]
    Window = creatingFloors(void, Glass, slab, solidPurlin, No_of_Floors)[1]
    GlassFrames = creatingFloors(void, Glass, slab, solidPurlin, No_of_Floors)[2]
    pass
    
    #Flatten bottomCurve
    Building = th.list_to_tree(Building)
    Building.Flatten()
    
    Window = th.list_to_tree(Window)
    Window.Flatten()
    
    GlassFrames = th.list_to_tree(GlassFrames)
    GlassFrames.Flatten()

randomHt = []
i = 1
while i<= len(bldgBaseCrv):
    randomHt.append(rd.randint(4,12))
    i +=1
print randomHt
# ---------- end python_3 ----------
parcelcurve_2 = Curve(crv_7)
number_slider_13 = Slider(4, range=1..5)  # disabled
number_slider_14 = Slider(10, range=10..20)  # disabled
number_slider_15 = Slider(11, range=1..20)  # disabled
number_slider_16 = Slider(4, range=3..6)  # disabled
number_slider_17 = Slider(3, range=3..6)  # disabled

# ---- group: Building Formation
# Building Formation
python_4 = GhPythonScript(
    ParcelCurve=parcelcurve,
    Building=number_slider_7,
    Courtyard_Toggle=toggle,
    CourtyardOff=number_slider_8,
    BuildingHt=number_slider_12,
    Stilt_Floor_Ht=number_slider_11,
    No_of_Floors=Slider(10, range=0..10),
    Random_Ht_Toggle=toggle_2,
    MaxVal=number_slider_9,
    MinVal=number_slider_10)  # -> out, building_profileCrv, building_profileSrf, AllSolids, InColSolid, OutColSolid, topOutCircle, BaseOutCircle; inputs ParcelCurve: list of Curve, No_of_Floors: Int32
# ---------- python_4: Python ----------
__author__ = "DARSHAN.H.CHAVAN.H"
__version__ = "2022.05.17"

"""
Note:
Curves are inputted as a list access in python component and to access 
each item "for loop" is used repeatedely.
"""

'''     Importing Libraries       '''

import rhinoscriptsyntax as rs
import scriptcontext as sc
import ghpythonlib.treehelpers as th
import random as rd

#Converting rhinogeo to GUID
ParcelCrv = []
for i in ParcelCurve:
    ParcelCrv.append(sc.doc.Objects.AddCurve(i))

'''     Building_profile       '''

def Building_profile(ParcelCrv):
    #Centre of the Parcels
    CentreParcel = []
    for i in ParcelCrv:
        CentreParcel.append(rs.CurveAreaCentroid(i))
    
    #Offset of Parcels to make building outline
    OffsetCrv = []
    for i, j in zip(ParcelCurve,CentreParcel):
        OffsetCrv.append(rs.OffsetCurve(i, j[0], float(Building)))
    return OffsetCrv

# Calling function Courtyard
OffsetCrv = Building_profile(ParcelCrv)

# Centre of the curves
CentreOffsetCrv = []
for i in OffsetCrv:
    CentreOffsetCrv.append(rs.CurveAreaCentroid(i))

# Courtyard inner curve
InnerCrv = []
for i, j in zip(OffsetCrv,CentreOffsetCrv):
    InnerCrv.append(rs.OffsetCurve(i, j[0], float(CourtyardOff)))

'''     Courtyard       '''

def Courtyard(OffsetCrv, BuildingHt, CourtyardOff) :
    if Courtyard_Toggle:
        
        # Centre of the curves
        CentreOffsetCrv = []
        for i in OffsetCrv:
            CentreOffsetCrv.append(rs.CurveAreaCentroid(i))

        # Courtyard inner curve
        InnerCrv = []
        for i, j in zip(OffsetCrv,CentreOffsetCrv):
            InnerCrv.append(rs.OffsetCurve(i, j[0], float(CourtyardOff)))

        # Building profile Curve(1Bldg = 2 curve)
        building_profileCrv = []
        for i, j in zip(OffsetCrv, InnerCrv):
            building_profileCrv.append([i,j])

        # Buildng profile Surface
        building_profileSrf = []
        for i in building_profileCrv:
            building_profileSrf.append(rs.AddPlanarSrf(i))

        # Building profile Solid
        Building_Solid = []
        for i in building_profileSrf:

            Building_Solid.append(rs.ExtrudeSurface(
                i, rs.AddLine((0,0,0), (0,0,BuildingHt))))

    #Toggle Off
    else:
        # Building profile Curve(1Bldg = 1 curve)
        building_profileCrv = OffsetCrv

        # Building profile Surface
        building_profileSrf = []
        for i in OffsetCrv:
            building_profileSrf.append(rs.AddPlanarSrf(i))

        # Building profile Solid
        Building_Solid = []
        for i in building_profileSrf:
            Building_Solid.append(rs.ExtrudeSurface(
                i, rs.AddLine((0,0,0), (0,0,BuildingHt) )))

    return building_profileCrv, building_profileSrf, Building_Solid

# Calling function Courtyard
building_profileCrv = Courtyard(OffsetCrv, BuildingHt, CourtyardOff)[0]
building_profileSrf = Courtyard(OffsetCrv, BuildingHt, CourtyardOff)[1]
Building_Solid = Courtyard(OffsetCrv, BuildingHt, CourtyardOff)[2]

'''     Random Stilt_Floor_Ht Toggle     '''

def randomHt(building_profileCrv, Building_Solid, MinVal, MaxVal):

    #Toggle on
    if Random_Ht_Toggle:
        #Creating random no. equal to total no. of parcels 
        #and storing in an empty list
        rndmStilt_Floor_Ht = []
        i = 1
        while i <= len(building_profileCrv):
            #min and max values are users parameter for some sort of control
            rndmStilt_Floor_Ht.append(rd.randint(MinVal, MaxVal))
            i += 1

        #Moving the solid building parcels with random Stilt_Floor_Ht
        TransformObj = []
        for i,j in zip(Building_Solid, rndmStilt_Floor_Ht):
            TransformObj.append(rs.MoveObject(i, [0, 0, j]))

    #Toggle Off
    else:
        rndmStilt_Floor_Ht = 0
        # Moving solid building parcels with users input Stilt_Floor_Ht
        TransformObj = []
        for i in Building_Solid:
             TransformObj.append(rs.MoveObject(i, [0, 0, Stilt_Floor_Ht]))

    #Return Object
    return TransformObj, rndmStilt_Floor_Ht 

# Calling function randomHt
TransformObj = randomHt(building_profileCrv, Building_Solid, MinVal, MaxVal)[0]
rndmStilt_Floor_Ht = randomHt(building_profileCrv, Building_Solid, MinVal, MaxVal)[1]

'''     Columns of building if elevated     '''

if Stilt_Floor_Ht != 0:

    if Courtyard_Toggle:

        """     Centre line offset of Outter Column    """
        #Centre of the OffsetCrv
        CentreOffsetCrv = []
        for i in OffsetCrv:
            CentreOffsetCrv.append(rs.CurveAreaCentroid(i))

        #Offset of Parcels( Outer)
        OutColOff = []
        for i, j in zip(OffsetCrv,CentreOffsetCrv):
            OutColOff.append(rs.OffsetCurve(i, j[0], float(2)))

        """     Centre line offset of Inner Column    """
        #Centre of the OffsetCrv
        CentreInnerCrv = []
        for i in InnerCrv:
            CentreInnerCrv.append(rs.CurveAreaCentroid(i))

        #Offset of Parcels (Inner)
        InColOff = []
        for i, j in zip(InnerCrv,CentreInnerCrv):
            InColOff.append(rs.OffsetCurve(i, j[0], float(-2)))

        """     division points     """
        #division of colum centre line
        DivOutPnts = []
        DivInPnts = []
        for i, j in zip(OutColOff, InColOff):
            DivOutPnts.append(rs.DivideCurveLength(i, 5, False, True))
            DivInPnts.append(rs.DivideCurveLength(j, 5, False, True))

        #Convering 3Dpoint to Guid
        BaseOutGuid = []
        for Outpnts in DivOutPnts:
            for i in Outpnts:
                BaseOutGuid.append(sc.doc.Objects.AddPoint(i))
        BaseInGuid = []
        for Inpnts in DivInPnts:
            for i in Inpnts:
                BaseInGuid.append(sc.doc.Objects.AddPoint(i))
                
        #making  top outer circles for columns ########
        BaseOutCircle = []
        for i in BaseOutGuid:
            BaseOutCircle.append(rs.AddCircle(i,0.25))

        #making  top inner circles for columns ########
        BaseInCircle = []
        for i in BaseInGuid:
            BaseInCircle.append(rs.AddCircle(i,0.25))
        
        #Convering 3Dpoint to Guid
        GuidpointOut = []
        GuidpointIn = []
        for Outpnt in DivOutPnts:
            for i in Outpnt:
                GuidpointOut.append(sc.doc.Objects.AddPoint(i))
        for Inpnt in DivInPnts:
            for i in Inpnt:
                GuidpointIn.append(sc.doc.Objects.AddPoint(i))

        #moving Points
        TopOutPnts = []
        TopInPnts = []
        for i in GuidpointOut:
            TopOutPnts.append(rs.MoveObject(i, [0,0,Stilt_Floor_Ht*2]))
        for i in GuidpointIn:
            TopInPnts.append(rs.MoveObject(i, [0,0,Stilt_Floor_Ht*2]))
        
        #making  top outer circles for columns #####
        topOutCircle = []
        for i in TopOutPnts:
            topOutCircle.append(rs.AddCircle(i,0.25))

        #making  top inner circles for columns #######
        bottomInCircle = []
        for i in TopInPnts:
            bottomInCircle.append(rs.AddCircle(i,0.25))

        #loft
        OutColSolid = []
        for i, j in zip(BaseOutCircle, topOutCircle):
            OutColSolid.append(rs.AddLoftSrf([i, j]))

        InColSolid = []
        for i, j in zip(BaseInCircle, bottomInCircle):
            OutColSolid.append(rs.AddLoftSrf([i, j]))
        
                #Flatten to visualise in Rhino-Grashopper
        InColSolid = th.list_to_tree(InColSolid)
        InColSolid.Flatten()

        OutColSolid = th.list_to_tree(OutColSolid)
        OutColSolid.Flatten()

    #When there is no courtyard and Stilt_Floor_Ht is not equal to zero
    else:
        #Centre of the OffsetCrv
        CentreOffsetCrv = []
        for i in OffsetCrv:
            CentreOffsetCrv.append(rs.CurveAreaCentroid(i))

        #Offset of Parcels( Outer)
        OutColOff = []
        for i, j in zip(OffsetCrv,CentreOffsetCrv):
            OutColOff.append(rs.OffsetCurve(i, j[0], float(2)))

        #Centre of the OutColOff
        CentreOutColOff = []
        for i in OutColOff:
            CentreOutColOff.append(rs.CurveAreaCentroid(i))

        #Offset of OutColOff( Outer)
        InnerColOff = []
        for i, j in zip(OutColOff,CentreOutColOff):
            InnerColOff.append(rs.OffsetCurve(i, j[0], float(6)))

        """     division points     """
        #division of column centre line
        DivOutPnts = []
        DivInPnts = []
        for i, j in zip(OutColOff, InnerColOff):
            DivOutPnts.append(rs.DivideCurveLength(i, 5, False, True))
            DivInPnts.append(rs.DivideCurveLength(j, 5, False, True))

        #Convering 3Dpoint to Guid
        BaseOutGuid = []
        BaseInGuid = []
        for Outpnts in DivOutPnts:
            for i in Outpnts:
                BaseOutGuid.append(sc.doc.Objects.AddPoint(i))
        BaseInGuid = []
        for Inpnts in DivInPnts:
            for i in Inpnts:
                BaseInGuid.append(sc.doc.Objects.AddPoint(i))

        #making  top outer circles for columns ########
        BaseOutCircle = []
        for i in BaseOutGuid:
            BaseOutCircle.append(rs.AddCircle(i,0.25))

        #making  top inner circles for columns ########
        BaseInCircle = []
        for i in BaseInGuid:
            BaseInCircle.append(rs.AddCircle(i,0.25))

        #Convering 3Dpoint to Guid
        GuidpointOut = []
        GuidpointIn = []
        for Outpnt in DivOutPnts:
            for i in Outpnt:
                GuidpointOut.append(sc.doc.Objects.AddPoint(i))
        for Inpnt in DivInPnts:
            for i in Inpnt:
                GuidpointIn.append(sc.doc.Objects.AddPoint(i))

        #moving Points
        TopOutPnts = []
        TopInPnts = []
        for i in GuidpointOut:
            TopOutPnts.append(rs.MoveObject(i, [0,0,Stilt_Floor_Ht*2]))
        for i in GuidpointIn:
            TopInPnts.append(rs.MoveObject(i, [0,0,Stilt_Floor_Ht*2]))

        #making  top outer circles for columns #####
        topOutCircle = []
        for i in TopOutPnts:
            topOutCircle.append(rs.AddCircle(i,0.25))

        #making  top inner circles for columns #######
        bottomInCircle = []
        for i in TopInPnts:
            bottomInCircle.append(rs.AddCircle(i,0.25))

        #loft
        OutColSolid = []
        for i, j in zip(BaseOutCircle, topOutCircle):
            OutColSolid.append(rs.AddLoftSrf([i, j]))

        InColSolid = []
        for i, j in zip(BaseInCircle, bottomInCircle):
            OutColSolid.append(rs.AddLoftSrf([i, j]))

        #Flatten to visualise in Rhino-Grashopper
        InColSolid = th.list_to_tree(InColSolid)
        InColSolid.Flatten()

        OutColSolid = th.list_to_tree(OutColSolid)
        OutColSolid.Flatten()

#When Stilt_Floor_Ht is equal to zero
else:
     pass

'''     Adding Floors     '''

def AddingFloors(TransformObj, BuildingHt, No_of_Floors):
    #Storing floor in empty list
    AllSolids = []
    # Iterating through building solids
    for i in TransformObj:
        #Adding range to define no. of copies
        for j in range(No_of_Floors):
            # Floor copy
            AllSolids.append(rs.CopyObject(i, (0,0, BuildingHt*j)))
    #Return
    return AllSolids

#Calling function AddingFloors
AllSolids = AddingFloors(TransformObj, BuildingHt, No_of_Floors)


'''     Outputs     '''

#Flatten building_profile
building_profileCrv = th.list_to_tree(building_profileCrv)
building_profileCrv.Flatten()

#Flatten building_Surface
building_profileSrf = th.list_to_tree(building_profileSrf)
building_profileSrf.Flatten()

#Flatten Building_Solid
AllSolids = th.list_to_tree(AllSolids)
AllSolids.Flatten()
# ---------- end python_4 ----------

# ---- group: Abstract Building
# Abstract Building
python_5 = GhPythonScript(
    ParcelCurve=parcelcurve_2,
    OffDist=Slider(10, range=5..20),
    Add_Sub_Toggle=Toggle(False),
    RandomHtToggle=Toggle(True),
    MinHt=Slider(20, range=0..20),
    MaxHt=Slider(132, range=0..200),
    No_of_blocks=Slider(56, range=0..100),
    BuildingHt=Slider(50, range=10..50),
    Seeds=Slider(3, range=1..5))  # -> out, AddPoints, Solid, SubPoints; inputs ParcelCurve: list of Curve; disabled
# ---------- python_5: Python ----------
__author__ = "DARSHAN.H.CHAVAN.H"
__version__ = "2022.05.21"

'''     Importing Libraries       '''

import rhinoscriptsyntax as rs
import scriptcontext as sc
import ghpythonlib.treehelpers as th
import random as rd
import ghpythonlib.components as ghc #used four times for same command 

'''         Parcel Offset, surface and solid        '''

#Convertnig rhino geometry to GUID
GuidCrv = []
for i in ParcelCurve:
    GuidCrv.append(sc.doc.Objects.AddCurve(i))

#Centre of the curve
CentreCrv = []
for i in GuidCrv:
    CentreCrv.append(rs.CurveAreaCentroid(i))

#Converting to guid point
Guidpt = []
for i in ParcelCurve:
    Guidpt.append(sc.doc.Objects.AddCurve(i))

#Offset Curve
OffsetCrv = []
for i, j in zip(GuidCrv, CentreCrv):
    OffsetCrv.append(rs.OffsetCurve( i, j[0], OffDist))
    
#Surface from curve
ParcelSrf = []
for i in OffsetCrv:
    ParcelSrf.append(rs.AddPlanarSrf(i))

'''         Building forming method and height        '''
""" 
There are two building forming methods: additive and substractive. First IF
condiion is used to turn On - Off Add-substract method and second If condition
is used to turn On - Off random height of the building.
"""

# Toggle True(Addition method)
if Add_Sub_Toggle:
    # Toggle True(Random ht)
    if RandomHtToggle:

        #Creating random numbers equal to total no. of parcels
        #storing in an empty list
        RandomHt = []
        i = 1
        while i <= len(ParcelCurve):
            #min and max values are users parameter for some sort of control
            RandomHt.append(rd.randint(MinHt, MaxHt))
            i += 1
        #Extruding parcels with random Stilt_Floor_Ht
        solid = []
        for i, j in zip(ParcelSrf, RandomHt):
            solid.append(rs.ExtrudeSurface(
                i, rs.AddLine((0,0,0), (0,0,j)), True))

        #Populating points inside soild (for additive method)
        AddPopuPnts = []
        for i in solid:
            AddPopuPnts.append(ghc.PopulateGeometry(
                [rs.coercebrep(i)], [No_of_blocks], [Seeds]))

        #Flattening to visualise in Rhinoceros-Grasshopper
        AddPoints = th.list_to_tree(AddPopuPnts)
        AddPoints.Flatten()

        Solid = th.list_to_tree(solid)
        Solid.Flatten()
    # Toggle False(Random ht Off)
    else:

        #Extruding surface with given height
        solid = []
        for i in ParcelSrf:
            solid.append(rs.ExtrudeSurface(
                i, rs.AddLine((0,0,0), (0,0,BuildingHt)), True))

        #Populating points inside soild (for additive method)
        AddPopuPnts = []
        for i in solid:
            AddPopuPnts.append(ghc.PopulateGeometry(
                [rs.coercebrep(i)], [No_of_blocks], [Seeds]))

        #Flattening to visualise in Rhinoceros-Grasshopper
        AddPoints = th.list_to_tree(AddPopuPnts)
        AddPoints.Flatten()

        Solid = th.list_to_tree(solid)
        Solid.Flatten()

# Toggle Flase(Substraction method)
else:
    # Toggle True(Random ht)
    if RandomHtToggle:

        #Creating random numbers equal to total no. of parcels
        #storing in an empty list
        RandomHt = []
        i = 1
        while i <= len(ParcelCurve):
            #min and max values are users parameter for some sort of control
            RandomHt.append(rd.randint(MinHt, MaxHt))
            i += 1

        #Extruding parcels with random Stilt_Floor_Ht
        solid = []
        for i, j in zip(ParcelSrf, RandomHt):
            solid.append(rs.ExtrudeSurface(
                i, rs.AddLine((0,0,0), (0,0,j)), True))

        hollowSrf = []
        for i, j in zip(ParcelSrf, RandomHt):
            hollowSrf.append(rs.ExtrudeSurface(
                i, rs.AddLine((0,0,0), (0,0,j)), False))
        
        #Populating points on surface of the soild (for subtractive method)
        SubPopuPnts = []
        for i in hollowSrf:
            SubPopuPnts.append(ghc.PopulateGeometry(
                [rs.coercebrep(i)], [No_of_blocks], [Seeds]))

        #Flattening to visualise in Rhinoceros-Grasshopper
        SubPoints = th.list_to_tree(SubPopuPnts)
        SubPoints.Flatten()

        Solid = th.list_to_tree(solid)
        Solid.Flatten()

    # Toggle False(Random ht Off)
    else:
        #Extruding surface with given height
        solid = []
        for i in ParcelSrf:
            solid.append(rs.ExtrudeSurface(
                i, rs.AddLine((0,0,0), (0,0,BuildingHt)), True))

        hollowSrf = []
        for i in ParcelSrf:
            hollowSrf.append(rs.ExtrudeSurface(
                i, rs.AddLine((0,0,0), (0,0,BuildingHt)), False))

        #Populating points on surface of the soild (for subtractive method)
        SubPopuPnts = []
        for i in hollowSrf:
            SubPopuPnts.append(ghc.PopulateGeometry(
                [rs.coercebrep(i)], [No_of_blocks], [Seeds]))

        #Flattening to visualise in Rhinoceros-Grasshopper
        SubPoints = th.list_to_tree(SubPopuPnts)
        SubPoints.Flatten()

        Solid = th.list_to_tree(solid)
        Solid.Flatten()
# ---------- end python_5 ----------

# ---- group: Recursive Building
# Recursive Building
python_6 = GhPythonScript(
    ParcelCurve=crv_8,
    OffsetBldg=Slider(2, range=1..20),
    No_of_Floors=Slider(9, range=1..20),
    Rot_Angle=Slider(17, range=0..90),
    ScaleFactor=Slider(0.6, range=0..1),
    Htfactor=Slider(4, range=0..5))  # -> out, Buildings; inputs No_of_Floors: Int32; disabled
# ---------- python_6: Python ----------
__author__ = "DARSHAN.H.CHAVAN.H"
__version__ = "2022.05.21"

import rhinoscriptsyntax as rs
import random as rd
#Centre of the curves
centre = rs.CurveAreaCentroid(ParcelCurve)
#Offset curve
offsetcurve = rs.OffsetCurve(ParcelCurve, centre[0], OffsetBldg)

#Empty list to append tranform object
Buildings = []

for i in range(No_of_Floors):
    #centre
    c = rs.CurveAreaCentroid(offsetcurve)
    #Scale
    a = rs.ScaleObject(offsetcurve, c[0],[ScaleFactor, ScaleFactor, 0])
    #Rotation
    a = rs.RotateObject(a, c[0], Rot_Angle)
    #Surface
    a = rs.AddPlanarSrf(a)
    #Extrude Surface
    a = rs.ExtrudeSurface(a, rs.AddLine((0,0,0),(0,0,3*Htfactor)), True)
    #Moving object and appending to empty list
    Buildings.append(rs.MoveObject(a, (0,0,3*i*Htfactor)))
# ---------- end python_6 ----------

# ----
toggle_3 = BooleanToggle(True)  # disabled
number_slider_18 = Slider(0.3, range=0..1)

# ---- group: Building Formation
python_7 = GhPythonScript(
    ParcelCurve=parcelcurve,
    Building=number_slider_7,
    Courtyard_Toggle=toggle,
    CourtyardOff=number_slider_8,
    BuildingHt=number_slider_12,
    Stilt_Floor_Ht=number_slider_11,
    No_of_Floors=number_slider_6,
    Random_Ht_Toggle=toggle_2,
    MaxVal=number_slider_9,
    MinVal=number_slider_10)  # -> out, building_profileCrv, building_profileSrf, AllSolids, InColSolid, OutColSolid, topOutCircle, BaseOutCircle; inputs ParcelCurve: list of Curve, No_of_Floors: Int32; disabled; same code as python_4

# ----
brep = Brep(python_3.Window)
brep_2 = Brep(python_3.Building)
number_slider_19 = Slider(0.3, range=0..1)  # disabled
python_8 = GhPythonScript(
    ParcelCurve=parcelcurve,
    Toggle_Podium=toggle_3,
    PodiumHt=number_slider_17,
    Bldg_Boundary=number_slider_13,
    Floor_Ht=number_slider_16,
    No_of_Floors=number_slider_15,
    No_of_Frames=number_slider_14)  # -> out, Window, Building, GlassFrames, Info; inputs ParcelCurve: list of Curve, Bldg_Boundary: Int32, Floor_Ht: Int32, No_of_Floors: Int32; disabled
# ---------- python_8: Python ----------
__author__ = "DARSHAN.H.CHAVAN.H"
__version__ = "2022.06.06"

import rhinoscriptsyntax as rs
import scriptcontext as sc
import ghpythonlib.treehelpers as th

def basicGeo(ParcelCurve):
    #Converting Rhino Geo to guid
    GuidCrv = []
    for i in ParcelCurve:
        GuidCrv.append(sc.doc.Objects.AddCurve(i))
    
    #Centre of the curve
    Centres = []
    for i in GuidCrv:
        Centres.append(rs.CurveAreaCentroid(i))
        
    #Offset of curve
    BldgCrv = []
    for i,j in zip(GuidCrv,Centres):
        BldgCrv.append(rs.OffsetCurve(i, j[0], Bldg_Boundary))
    
    #move Ceiling Curve in Z direction and exploding base curve
    CeilingCrv = []
    Explode_Crv = []
    for i,j in zip(BldgCrv, Centres):
        CeilingCrv.append(rs.CopyObject(i, [0,0,Floor_Ht - 0.15]))
        Explode_Crv.append(rs.ExplodeCurves(i))
    return CeilingCrv, Explode_Crv, BldgCrv
    
CeilingCrv = basicGeo(ParcelCurve)[0]
Explode_Crv = basicGeo(ParcelCurve)[1]
BldgCrv = basicGeo(ParcelCurve)[2]


if Toggle_Podium:
    print ( "Create Podium" )
        #Converting Rhino Geo to guid
    GuidCrv = []
    for i in ParcelCurve:
        GuidCrv.append(sc.doc.Objects.AddCurve(i))
    
    #Centre of the curve
    Centres = []
    for i in GuidCrv:
        Centres.append(rs.CurveAreaCentroid(i))
        
    #move Ceiling Curve in Z direction and exploding base curve
    PodCeilingCrv = []
    PodExplode_Crv = []
    for i,j in zip(BldgCrv, Centres):
        PodCeilingCrv.append(rs.CopyObject(i, [0,0,Floor_Ht - 0.15]))
        PodExplode_Crv.append(rs.ExplodeCurves(i))

else:
    print( "Skip Podium" )
def createGlassandBldgFrame(Explode_Crv):
    #extruding explode curve
    surfaces = []
    for list in Explode_Crv:
        for i in list:
            surfaces.append(rs.ExtrudeCurve(i, (rs.AddLine([0,0,0],[0,0,Floor_Ht - 0.15]))))
    
    #Centre of the surface  <3dPoint>
    cSrf =  []
    for i in surfaces:
        cSrf.append(rs.SurfaceAreaCentroid(i))
    
    #Scaling it small for window puncture   <Surface>
    Glass = []
    for i, j in zip(surfaces, cSrf):
        Glass.append(rs.ScaleObject(i,j[0], [ 0.9, 0.9, 0.9], True))
    
    #Making Solid of window to puncture <Solid>
    solidFrame = []
    for i in Glass:
        solidFrame.append(rs.OffsetSurface(i, 0.5, 0.001, True, True))
    
    #Making Solid of window to puncture <Solid>
    solidFramenew = []
    for i in surfaces:
        solidFramenew.append(rs.OffsetSurface(i, 0.230, 0.001, False, True))
    
    void = []
    for i, j in zip(solidFramenew, solidFrame):
        void.append(rs.BooleanDifference(i,j,False))
    return Glass, void

Glass = createGlassandBldgFrame(Explode_Crv)[0]
void = createGlassandBldgFrame(Explode_Crv)[1]

def createSolidPurlin(Glass, No_of_Frames):
    #Extracting border curves from glass surface    <Curves>
    glassFrame = []
    for i in Glass:
        glassFrame.append(rs.DuplicateSurfaceBorder(i))
    
    #Exploding curves   <Curve>
    expCurve = []
    for i in glassFrame:
        expCurve.append(rs.ExplodeCurves(i))
    
    #Extracting top and botttom curve from the frame    <Curves>
    topCurve = []
    bottomCurve = []
    for i in expCurve:
        topCurve.append(i[3])
        bottomCurve.append(i[1])
    
    #Dividing the top and bottom curve  <3dPoint>
    topDivPnts = []
    bottomDivPnts = []
    for i,j in zip(topCurve, bottomCurve):
        topDivPnts.append(rs.DivideCurve(i, No_of_Frames, True, True))
        bottomDivPnts.append(rs.DivideCurve(j, No_of_Frames, True, True))
    
    #Creating curves from top and bottom points  <curves>
    purlinCrv = []
    topCircle = []
    bottomCircle = []
    for i,j in zip(topDivPnts, bottomDivPnts):
        #List j is reversed to get straight lines
        for p,k in zip(i,j[::-1]):
            #Converting rhino point to Guid point using sc
            purlinCrv.append(rs.AddLine(sc.doc.Objects.AddPoint(p),sc.doc.Objects.AddPoint(k)))
            topCircle.append(rs.AddCircle(sc.doc.Objects.AddPoint(p), 0.05))
            bottomCircle.append(rs.AddCircle(sc.doc.Objects.AddPoint(k), 0.05))
    
    #Solid purlin    <Solid>
    solidPurlin = []
    for i,j in zip(topCircle, bottomCircle):
        solidPurlin.append(rs.AddLoftSrf([i,j]))
    return solidPurlin

solidPurlin = createSolidPurlin(Glass, No_of_Frames)
def slab(CeilingCrv):
    #Ceiling Surface
    CeilSrf = []
    for i in CeilingCrv:
        CeilSrf.append(rs.AddPlanarSrf(i))
    
    #Slab Solid
    slab = []
    for i in CeilSrf:
        line = rs.AddLine((0,0,0), (0,0, 0.2))
        slab.append(rs.ExtrudeSurface(i,line))
    return slab

#Calling slab function
slab = slab(CeilingCrv)

#info
areas = []
for i in BldgCrv:
    areas.append(("Block Area: " + str(rs.CurveArea(i)[0])))
Info = areas

def creatingFloors(void, Glass, slab, solidPurlin, No_of_Floors):
    Building = []
    Window = []
    for i, j in zip(void, Glass):
        for h in range(No_of_Floors):
            Building.append(rs.CopyObject(i, (0,0,Floor_Ht*h)))
            Window.append(rs.CopyObject(j, (0,0,Floor_Ht*h)))

    #Copying slab and adding to the Building list
    for i in slab:
        for h in range(No_of_Floors):
            Building.append(rs.CopyObject(i, (0,0,Floor_Ht*h)))

    #Copying frames and adding to the GlassFrames list
    GlassFrames = []
    for i in solidPurlin:
        for h in range(No_of_Floors):
            GlassFrames.append(rs.CopyObject(i, (0,0,Floor_Ht*h)))
    return Building, Window, GlassFrames
    
#Calling creatingFloors function
Building = creatingFloors(void, Glass, slab, solidPurlin, No_of_Floors)[0]
Window = creatingFloors(void, Glass, slab, solidPurlin, No_of_Floors)[1]
GlassFrames = creatingFloors(void, Glass, slab, solidPurlin, No_of_Floors)[2]


''' OUTPUT'''
#Flatten BldgCrv
GlassFrames = th.list_to_tree(GlassFrames)
GlassFrames.Flatten()

#Flatten Floorskin
Window = th.list_to_tree(Window)
Window.Flatten()

#Flatten bottomCurve
Building = th.list_to_tree(Building)
Building.Flatten()
# ---------- end python_8 ----------

# ----
# Addition Method
number_slider_20 = Slider(3, range=0..10)
box = CenterBox(Base=python_5.AddPoints, X=number_slider_20, Y=Slider(3, range=0..10), Z=Slider(10, range=0..10))
sunion = SolidUnion(Breps=graft(box))  # disabled

# ----
# Substraction Method
box_2 = CenterBox(Base=python_5.SubPoints, X=Slider(9, range=0..10), Y=Slider(10, range=0..10), Z=Slider(1, range=0..10))
sdiff = SolidDifference(BrepsA=python_5.Solid, BrepsB=flatten(box_2))  # disabled

brep_3 = Brep([python_4.OutColSolid, python_4.InColSolid])
crv_10 = Curve(python_4.topOutCircle)
crv_11 = Curve(python_4.BaseOutCircle)
srf_4 = Surface(python_4.building_profileSrf)
crv_12 = Curve(python_4.building_profileCrv)
brep_4 = Brep(python_4.AllSolids)
number_slider_21 = Slider(30, range=0..100)
number_slider_22 = Slider(10, range=0..10)
brep_5 = Brep([python_7.OutColSolid, python_7.InColSolid])  # disabled
crv_13 = Curve(python_7.topOutCircle)  # disabled
crv_14 = Curve(python_7.BaseOutCircle)  # disabled
srf_5 = Surface(python_7.building_profileSrf)  # disabled
crv_15 = Curve(python_7.building_profileCrv)  # disabled
brep_6 = Brep(python_7.AllSolids)  # disabled
number_slider_23 = Slider(10, range=0..10)
number_slider_24 = Slider(10, range=0..10)
number_slider_25 = Slider(10, range=0..10)
number_slider_26 = Slider(5, range=0..10)
preview = CustomPreview(Geometry=python_3.Window, Material=ColourSwatch(SwatchColor=RGB(77, 134, 184)))
preview_2 = CustomPreview(Geometry=python_3.Building, Material=ColourSwatch(SwatchColor=RGB(50, 207, 71)))
preview_3 = CustomPreview(Geometry=python_3.GlassFrames, Material=ColourSwatch(SwatchColor=RGB(0, 0, 0)))
preview_4 = CustomPreview(Geometry=python_3.podGlassFrames, Material=ColourSwatch(SwatchColor=RGB(0, 0, 0)))
preview_5 = CustomPreview(Geometry=python_3.podWindow, Material=ColourSwatch(SwatchColor=RGB(94, 180, 255)))
preview_6 = CustomPreview(Geometry=python_3.podBuilding, Material=ColourSwatch(SwatchColor=RGB(207, 180, 50)))
number_slider_27 = Slider(4, range=1..5)  # disabled
number_slider_28 = Slider(10, range=10..20)  # disabled
number_slider_29 = Slider(15, range=1..20)  # disabled
number_slider_30 = Slider(4, range=3..6)  # disabled
number_slider_31 = Slider(3, range=3..6)  # disabled
toggle_4 = BooleanToggle(True)  # disabled
parcelcurve_3 = Curve(crv_7)  # disabled
rgb = ColourRGB(Alpha=255, Red=number_slider_26, Green=number_slider_26, Blue=number_slider_26)
python_9 = GhPythonScript(
    ParcelCurve=parcelcurve_3,
    Toggle_Podium=toggle_4,
    PodiumHt=number_slider_31,
    Bldg_Boundary=number_slider_27,
    Floor_Ht=number_slider_30,
    No_of_Floors=number_slider_29,
    No_of_Frames=number_slider_28)  # -> out, Window, Building, GlassFrames, Info; inputs ParcelCurve: list of Curve, Bldg_Boundary: Int32, Floor_Ht: Int32, No_of_Floors: Int32; disabled; same code as python_8

# ----
# Site Surfaces
crossref = CrossReference(CrossMode=1)  # -> ListParcelSrf, ListRoad_Srf, ListPathSrf
swatch = ColourSwatch(SwatchColor=RGB(191, 191, 191))
swatch_2 = ColourSwatch(SwatchColor=RGB(112, 112, 112))
swatch_3 = ColourSwatch(SwatchColor=RGB(255, 191, 191))
preview_7 = CustomPreview(Geometry=crossref.ListParcelSrf, Material=swatch)  # disabled
preview_8 = CustomPreview(Geometry=crossref.ListRoad_Srf, Material=swatch_2)  # disabled
preview_9 = CustomPreview(Geometry=crossref.ListPathSrf, Material=swatch_3)  # disabled

# ----
# Site Solid
crossref_2 = CrossReference(ListParcelSoild=python_2.ParcelSoild, ListRoadSolid=python_2.RoadSolid, ListPathSoild=python_2.PathSoild, CrossMode=1)  # -> ListParcelSoild, ListRoadSolid, ListPathSoild
preview_10 = CustomPreview(Geometry=crossref_2.ListParcelSoild, Material=swatch)
preview_11 = CustomPreview(Geometry=crossref_2.ListRoadSolid, Material=swatch_2)
preview_12 = CustomPreview(Geometry=crossref_2.ListPathSoild, Material=swatch_3)

# ----
# .                          Geometry Colour Display                             .
# Site Info
merge_3 = Merge(Data1=site_info.Centre, Data2=site_info.Site_Vertices)
previewlw = CustomPreviewLineweights(
    Geometry=site_info.Edges,
    Shader=ColourSwatch(SwatchColor=RGB(61, 242, 206)),
    Thickness=Slider(3, range=0..10),
    Absolute=False)  # disabled
dots = DotDisplay(Point=merge_3, Colour=ColourSwatch(SwatchColor=RGB(242, 94, 94)), Size=Slider(1.399, range=0..5))  # disabled
points = PointList(Points=merge_3, Size=Slider(4.726, range=0..5))  # disabled

# ----
# OffsetSrf
# InteriorSrf
swatch_4 = ColourSwatch(SwatchColor=RGB(247, 163, 163))
swatch_5 = ColourSwatch(SwatchColor=RGB(186, 182, 182))
preview_13 = CustomPreview(Geometry=python.OffsetSrf, Material=swatch_5)  # disabled
preview_14 = CustomPreview(Geometry=python.InteriorSrf, Material=swatch_4)  # disabled

# ----
# Site Curves
crossref_3 = CrossReference(CrossMode=1)  # -> ListParcelCurve, ListRoadCrv, ListPathCrv
previewlw_2 = CustomPreviewLineweights(Geometry=crossref_3.ListParcelCurve, Shader=rgb, Thickness=Slider(3, range=0..10), Absolute=False)  # disabled
previewlw_3 = CustomPreviewLineweights(Geometry=crossref_3.ListRoadCrv, Shader=swatch_2, Thickness=Slider(3, range=0..10), Absolute=False)  # disabled
previewlw_4 = CustomPreviewLineweights(Geometry=crossref_3.ListPathCrv, Shader=swatch_3, Thickness=Slider(3, range=0..10), Absolute=False)  # disabled

panel_3 = Panel(python_9.Info)  # disabled
preview_15 = CustomPreview(Geometry=site_info.Surface, Material=swatch_4)  # disabled
colour = ColourPicker(PickedColour=RGBA(235, 106, 106, 160))

# ----
# Sort Area
swatch_6 = ColourSwatch(SwatchColor=RGBA(232, 139, 9, 198))
# Sorted Space
srf_6 = Surface()
srf_7 = Surface()
# Parcel Shaped Building
swatch_7 = ColourSwatch(SwatchColor=RGBA(189, 240, 70, 167))
preview_16 = CustomPreview(Geometry=srf_6, Material=swatch_5)  # disabled
# Min Space
preview_17 = CustomPreview(Geometry=srf_7, Material=swatch_7)

# ----
# Buildings
# Stilt Floor column
merge_4 = Merge()
preview_18 = CustomPreview(Geometry=merge_4, Material=ColourSwatch(SwatchColor=RGB(133, 131, 131)))  # disabled
preview_19 = CustomPreview(Geometry=python_4.AllSolids, Material=colour)  # disabled

# ----
# Recursive tower Bldg
preview_20 = CustomPreview(Geometry=python_6.Buildings, Material=colour)  # disabled

# ----
# Add Bldg
# Sub Bldg
preview_21 = CustomPreview(Geometry=sunion, Material=colour)  # disabled
preview_22 = CustomPreview(Geometry=sdiff, Material=colour)  # disabled
